# Dynamo graph robot-drawing.dyn (Dynamo 1.3.0.862)

# group: Choose the JSON file
file_path = Filename("..\02_processing_sketch\touch_drawing_to_json\data\171110_073423_drawing.json")

# group: Drawing parameters
code_block = CodeBlock()
# ---------- code_block.designscript (26 lines) ----------
// Tool + marker length
toolLength = 100;

// Processing screen properties
processingScreenWidth = 1920;
processingScreenHeight = 1080;

// Paper corner location in world coordinates and mm
paperCornerWorldX = 229;
paperCornerWorldY = -216;
paperCornerWorldZ = 85;

// Paper orientation in world coordinates: X vector of the width, Y vector of the height
paperXDirection = Vector.YAxis();
paperYDirection = Vector.XAxis();

// Paper size: height will be computed according to screen size factor
paperWidth = 17 * 25.4;

// Using vriable speed? If so, the robot movement will try to mimic the drawing pace
useVariableSpeed = false;
// If speed is variable, it can be amplified by a factor of:
speedFactor = 1.5;

// If constant speed, then draw at ... mm/s
constantSpeed = 40;
# ----------------------------------------

code_block_2 = CodeBlock { 0.5; }

# group: Create a Tool object representing a marker
code_block_3 = CodeBlock { "marker"; }
XY = Plane.XY()
offset = Plane.Offset(XY, code_block.toolLength)
create = MachinaDynamo.Tools.Create(code_block_3, XY, offset, code_block_2)

# group: Use marker tool
attach = MachinaDynamo.Actions.Attach(create)

# group: Start from 'home'
code_block_4 = CodeBlock { 100; }
speedTo = MachinaDynamo.Actions.SpeedTo(code_block_4)
code_block_5 = CodeBlock { 0; 90; }
axesTo = MachinaDynamo.Actions.AxesTo(code_block_5.out0, code_block_5.out0, code_block_5.out0, code_block_5.out0, code_block_5.out1, code_block_5.out0)

# group: Parse the JSON file
fromJsonFile = JsonTools.JsonTools.FromJsonFile(file_path)
keys = JsonElements.JsonObject.Keys(fromJsonFile)
valueByKey = JsonElements.JsonObject.ValueByKey(fromJsonFile, keys)
elements = JsonElements.JsonArray.Elements(valueByKey)
keys_2 = JsonElements.JsonObject.Keys(elements)
valueByKey_2 = JsonElements.JsonObject.ValueByKey(elements, keys_2)
elements_2 = JsonElements.JsonArray.Elements(valueByKey_2)
keys_3 = JsonElements.JsonObject.Keys(elements_2)
valueByKey_3 = JsonElements.JsonObject.ValueByKey(elements_2, keys_3)
code_block_6 = CodeBlock { 0; }
getItemAtIndex = List.GetItemAtIndex(list=valueByKey_3, index=code_block_6)
code_block_7 = CodeBlock { 0; }
getItemAtIndex_2 = List.GetItemAtIndex(list=getItemAtIndex@L4, index=code_block_7)

# group: Convert JSON file to target planes
code_block_8 = CodeBlock(csv=getItemAtIndex_2, screenW=code_block.processingScreenWidth, screenH=code_block.processingScreenHeight, paperCornerX=code_block.paperCornerWorldX, paperCornerY=code_block.paperCornerWorldY, paperCornerZ=code_block.paperCornerWorldZ, paperXVector=code_block.paperXDirection, paperYVector=code_block.paperYDirection, paperWidth=code_block.paperWidth)
# ---------- code_block_8.designscript (45 lines) ----------
// Get CSV text file
csv;

// Pixel size of the screen the points were captured at
screenW;
screenH;

// Paper location, orientation and width in mm (height will be computed according to screen factor)
paperCornerX;
paperCornerY;
paperCornerZ;
paperXVector;
paperYVector;
paperWidth;

// Parse points
t = List.GetItemAtIndex(csv@-2<1>, 1);
x = List.GetItemAtIndex(csv@-2<1>, 2);
y = List.GetItemAtIndex(csv@-2<1>, 3);
z = List.GetItemAtIndex(csv@-2<1>, 4);
v = List.GetItemAtIndex(csv@-2<1>, 5);
screenPoints = Autodesk.Point.ByCoordinates(x, y, z);
pCount = List.Count(csv@-3<1>);

// Transform to target 'paper' coordinates
sourcePlane = Plane.XY();
// (this is just for visual flavor)
planeCenter = Plane.Translate(Plane.XY(), 0.5 * screenW, 0.5 * screenH, 0);
rect = Rectangle.ByWidthLength(planeCenter, screenW, screenH);
sourceCS = CoordinateSystem.ByPlane(sourcePlane);


paperScaleFactor = paperWidth / screenW;
paperCornerPoint = Autodesk.Point.ByCoordinates(paperCornerX, paperCornerY, paperCornerZ);
paperCornerPlane = Plane.ByOriginXAxisYAxis(paperCornerPoint, paperXVector, paperYVector);
paperCornerCS = CoordinateSystem.Scale(CoordinateSystem.ByPlane(paperCornerPlane), paperCornerPlane, paperScaleFactor, paperScaleFactor, paperScaleFactor);

// Remap points
paperRect = Geometry.Transform(rect, sourceCS, paperCornerCS);
targetPoints = Geometry.Transform(screenPoints, sourceCS, paperCornerCS);
targetPointsChop = List.Chop(targetPoints, pCount);

planes = Plane.ByOriginXAxisYAxis(targetPointsChop, Vector.Reverse(Vector.XAxis()), Vector.YAxis());

velocities = List.Chop(v, pCount);
# ----------------------------------------

code_block_9 = CodeBlock(planes=code_block_8.planes) { planes; }
code_block_10 = CodeBlock(velocities=code_block_8.velocities) { velocities; }

# group: Generate Machina movement Actions
code_block_11 = CodeBlock(code_block_9, code_block_10, code_block.speedFactor, code_block.useVariableSpeed, code_block.constantSpeed)
# ---------- code_block_11.designscript (75 lines) ----------
travelSpeed = 100;
travelPrecision = 5;

leadOffset = -25;
leadSpeed = 50;
leadPrecision = 1;

traceSpeed = 25;
tracePrecision = 1;

planes;
velocities;
speedFactor;
variableSpeed;
maxSpeed;

program = [Imperative]
{
 actions = {};
 i = 0;
 for (pol in planes)
 {
  acts2 = {};
  j = 0;

  acts2 = List.AddItemToEnd(Actions.Message("Drawing stroke #" + i), acts2);

  // Travel to lead plane
  acts2 = List.AddItemToEnd(Actions.SpeedTo(travelSpeed), acts2);
  acts2 = List.AddItemToEnd(Actions.PrecisionTo(travelPrecision), acts2);
  leadIn = pol[0].Offset(leadOffset);
  acts2 = List.AddItemToEnd(Actions.TransformTo(leadIn), acts2);

  // Lead into first target
  acts2 = List.AddItemToEnd(Actions.SpeedTo(leadSpeed), acts2);
  acts2 = List.AddItemToEnd(Actions.PrecisionTo(leadPrecision), acts2);
  acts2 = List.AddItemToEnd(Actions.TransformTo(pol[0]), acts2);

  // Settings for tracing
  acts2 = List.AddItemToEnd(Actions.SpeedTo(traceSpeed), acts2);
  acts2 = List.AddItemToEnd(Actions.PrecisionTo(tracePrecision), acts2);

  // Don't repeat first target
  pol = List.RemoveItemAtIndex(pol, 0);
  j = j + 1;

  // Move to all targets
  for (p in pol)
  {
   if (variableSpeed == true) {
     v = Math.Ceiling(velocities[i][j] * speedFactor);
     if (v > maxSpeed)
     {
       v = maxSpeed;
     } else if (v == 0) {
       v = 1;
     }
     acts2 = List.AddItemToEnd(Actions.SpeedTo(v), acts2);
          j = j + 1;
        }
        acts2 = List.AddItemToEnd(Actions.TransformTo(p), acts2);
    }

  // Lead out
  acts2 = List.AddItemToEnd(Actions.SpeedTo(leadSpeed), acts2);
  acts2 = List.AddItemToEnd(Actions.PrecisionTo(leadPrecision), acts2);
  leadOut = pol[List.Count(pol)-1].Offset(leadOffset);
  acts2 = List.AddItemToEnd(Actions.TransformTo(leadOut), acts2);

    actions[i] = acts2;
     i = i + 1;
 }

 return = actions;
};
# ----------------------------------------

watch = Watch(code_block_11.out12)

# group: Go back 'home'
code_block_12 = CodeBlock { 100; }
speedTo_2 = MachinaDynamo.Actions.SpeedTo(code_block_12)
code_block_13 = CodeBlock { 0; 90; }
axesTo_2 = MachinaDynamo.Actions.AxesTo(code_block_13.out0, code_block_13.out0, code_block_13.out0, code_block_13.out0, code_block_13.out1, code_block_13.out0)

# group: Create program and clean null Actions
create_2 = List.Create(attach, speedTo, axesTo, watch, speedTo_2, axesTo_2)
flatten = Flatten(create_2)
boolean = BoolSelector(false)
clean = List.Clean(list=flatten, preserveIndices=boolean)

boolean_2 = BoolSelector(false)

# group: Compile the program into native code
code_block_14 = CodeBlock { "Tracer"; "ABB"; }
create_3 = MachinaDynamo.Robots.Create(code_block_14.out0, code_block_14.out1)
boolean_3 = BoolSelector(true)
compileProgram = MachinaDynamo.Programs.CompileProgram(create_3, clean, boolean_3, boolean_2)

# group: Export it as a file on your system
boolean_4 = BoolSelector(false)
fileName = FilePath.FileName(file_path, boolean_4)
code_block_15 = CodeBlock(str=fileName) { str; path = ".\\" + str + ".prg"; }
writeText = File.WriteText(code_block_15.path, compileProgram)

watch_2 = Watch(compileProgram)
watch_3 = Watch(getItemAtIndex_2)
code_block_16 = CodeBlock(rect=code_block_8.paperRect) { rect; }
watch_4 = Watch(code_block_15.path)
