# Dynamo graph parse-json.dyn (Dynamo 2.0.0.2885)

code_block = CodeBlock { "c:/users/martinno/files/new.json"; }
fromJsonFile = JsonTools.JsonTools.FromJsonFile(filepath=code_block)
keys = JsonElements.JsonObject.Keys(jsonObject=fromJsonFile.object)
valueByKey = JsonElements.JsonObject.ValueByKey(jsonObject=fromJsonFile.object, key=keys)
elements = JsonElements.JsonArray.Elements(jsonArray=valueByKey)
keys_2 = JsonElements.JsonObject.Keys(jsonObject=elements)
valueByKey_2 = JsonElements.JsonObject.ValueByKey(jsonObject=elements, key=keys_2)
elements_2 = JsonElements.JsonArray.Elements(jsonArray=valueByKey_2)
keys_3 = JsonElements.JsonObject.Keys(jsonObject=elements_2)
valueByKey_3 = JsonElements.JsonObject.ValueByKey(jsonObject=elements_2, key=keys_3)
